# Grasshopper definition tovarnaspodekavrsek.gh (Grasshopper 1.0.7)

panel = Panel("mezera")
panel_2 = Panel("pocetctvercu")
addition = Addition(A="10", B="47.5")
planesrf = PlaneSurface(Plane=PlaneXY(0, 0, 0), XSize="47.5", YSize="47.5")
series = Series(Start=0, Step=addition, Count="9")
X = UnitX(Factor=series)
graft = GraftTree(Tree=series, IncludeEmptyLists=True, IncludeNullItems=True)
move = Move(Geometry=planesrf, Motion=X)  # -> Geometry, Transform
Y = UnitY(Factor=graft)
move_2 = Move(Geometry=move.Geometry, Motion=Y)  # -> Geometry, Transform

colour = ColourPicker(PickedColour=RGB(252, 252, 252))
panel_3 = Panel("podlozka")
preview = CustomPreview(Geometry=[move_2.Geometry, planesrf], Material=colour)
series_2 = Series(Start=Button(), Step=1, Count=10)
panel_4 = Panel(series_2)
panel_5 = Panel(Slider(5, range=0..100))

dom = ConstructDomain(DomainStart="1", DomainEnd="8")
ma = MassAddition(Input=panel_5)  # -> Result, PartialResults
random = Random(Range=dom, Number="100", Seed=Slider(5720, range=0..10000))
round = Round(Number=random)  # -> Nearest, Floor, Ceiling
item = ListItem(List=round.Nearest, Index=ma.Result, Wrap=True)
dom_2 = ConstructDomain(DomainStart="0", DomainEnd="498")
random_2 = Random(Range=dom_2, Number="100", Seed=Slider(2158, range=0..10000))
item_2 = ListItem(List=random_2, Index=ma.Result, Wrap=True)

dom_3 = ConstructDomain(DomainStart="1", DomainEnd="8")
ma_2 = MassAddition(Input=panel_5)  # -> Result, PartialResults
random_3 = Random(Range=dom_3, Number="100", Seed=Slider(4233, range=0..10000))
round_2 = Round(Number=random_3)  # -> Nearest, Floor, Ceiling
item_3 = ListItem(List=round_2.Nearest, Index=ma_2.Result, Wrap=True)
dom_4 = ConstructDomain(DomainStart="0", DomainEnd="498")
random_4 = Random(Range=dom_4, Number="100", Seed=Slider(2455, range=0..10000))
item_4 = ListItem(List=random_4, Index=ma_2.Result, Wrap=True)

multiplication = Multiplication(A="10", B=item)
multiplication_2 = Multiplication(A="47.5", B=item)
subtraction = Subtraction(A=multiplication, B="10")
addition_2 = Addition(A=subtraction, B=multiplication_2)
X_2 = UnitX(Factor=addition_2)
Y_2 = UnitY(Factor=item_2)
vec = VectorXYZ(XComponent=X_2, YComponent=Y_2, ZComponent=0)  # -> Vector, Length
box = DomainBox(Base=vec.Vector, X="10", Y="10", Z="90")

dom_5 = ConstructDomain(DomainStart="1", DomainEnd="8")
ma_3 = MassAddition(Input=panel_5)  # -> Result, PartialResults
random_5 = Random(Range=dom_5, Number="100", Seed=Slider(4729, range=0..10000))
round_3 = Round(Number=random_5)  # -> Nearest, Floor, Ceiling
item_5 = ListItem(List=round_3.Nearest, Index=ma_3.Result, Wrap=True)
dom_6 = ConstructDomain(DomainStart="0", DomainEnd="448")
random_6 = Random(Range=dom_6, Number="100", Seed=Slider(3019, range=0..10000))
item_6 = ListItem(List=random_6, Index=ma_3.Result, Wrap=True)

dom_7 = ConstructDomain(DomainStart="1", DomainEnd="8")
ma_4 = MassAddition(Input=panel_5)  # -> Result, PartialResults
random_7 = Random(Range=dom_7, Number="100", Seed=Slider(2193, range=0..10000))
round_4 = Round(Number=random_7)  # -> Nearest, Floor, Ceiling
item_7 = ListItem(List=round_4.Nearest, Index=ma_4.Result, Wrap=True)
dom_8 = ConstructDomain(DomainStart="0", DomainEnd="448")
random_8 = Random(Range=dom_8, Number="100", Seed=Slider(2554, range=0..10000))
item_8 = ListItem(List=random_8, Index=ma_4.Result, Wrap=True)

dom_9 = ConstructDomain(DomainStart="1", DomainEnd="8")
ma_5 = MassAddition(Input=panel_5)  # -> Result, PartialResults
random_9 = Random(Range=dom_9, Number="100", Seed=Slider(2735, range=0..10000))
round_5 = Round(Number=random_9)  # -> Nearest, Floor, Ceiling
item_9 = ListItem(List=round_5.Nearest, Index=ma_5.Result, Wrap=True)
dom_10 = ConstructDomain(DomainStart="0", DomainEnd="448")
random_10 = Random(Range=dom_10, Number="100", Seed=Slider(3668, range=0..10000))
item_10 = ListItem(List=random_10, Index=ma_5.Result, Wrap=True)

multiplication_3 = Multiplication(A="10", B=item_9)
multiplication_4 = Multiplication(A="47.5", B=item_9)
subtraction_2 = Subtraction(A=multiplication_3, B="10")
addition_3 = Addition(A=subtraction_2, B=multiplication_4)
subtraction_3 = Subtraction(A=addition_3, B="25")
X_3 = UnitX(Factor=item_10)
Y_3 = UnitY(Factor=subtraction_3)
vec_2 = VectorXYZ(XComponent=X_3, YComponent=Y_3, ZComponent=0)  # -> Vector, Length
box_2 = DomainBox(Base=vec_2.Vector, X="10", Y="60", Z="90")

multiplication_5 = Multiplication(A="10", B=item_3)
multiplication_6 = Multiplication(A="47.5", B=item_3)
subtraction_4 = Subtraction(A=multiplication_5, B="10")
addition_4 = Addition(A=subtraction_4, B=multiplication_6)
X_4 = UnitX(Factor=item_4)
Y_4 = UnitY(Factor=addition_4)
vec_3 = VectorXYZ(XComponent=X_4, YComponent=Y_4, ZComponent=0)  # -> Vector, Length
box_3 = DomainBox(Base=vec_3.Vector, X="10", Y="10", Z="90")

dom_11 = ConstructDomain(DomainStart="1", DomainEnd="8")
ma_6 = MassAddition(Input=panel_5)  # -> Result, PartialResults
random_11 = Random(Range=dom_11, Number="100", Seed=Slider(3589, range=0..10000))
round_6 = Round(Number=random_11)  # -> Nearest, Floor, Ceiling
item_11 = ListItem(List=round_6.Nearest, Index=ma_6.Result, Wrap=True)
dom_12 = ConstructDomain(DomainStart="0", DomainEnd="448")
random_12 = Random(Range=dom_12, Number="100", Seed=Slider(3019, range=0..10000))
item_12 = ListItem(List=random_12, Index=ma_6.Result, Wrap=True)

multiplication_7 = Multiplication(A="10", B=item_5)
multiplication_8 = Multiplication(A="47.5", B=item_5)
subtraction_5 = Subtraction(A=multiplication_7, B="10")
addition_5 = Addition(A=subtraction_5, B=multiplication_8)
X_5 = UnitX(Factor=addition_5)
Y_5 = UnitY(Factor=item_6)
vec_4 = VectorXYZ(XComponent=X_5, YComponent=Y_5, ZComponent=0)  # -> Vector, Length
box_4 = DomainBox(Base=vec_4.Vector, X="10", Y="60", Z="90")

multiplication_9 = Multiplication(A="10", B=item_11)
multiplication_10 = Multiplication(A="47.5", B=item_11)
subtraction_6 = Subtraction(A=multiplication_9, B="10")
addition_6 = Addition(A=subtraction_6, B=multiplication_10)
subtraction_7 = Subtraction(A=addition_6, B="25")
Y_6 = UnitY(Factor=item_12)
X_6 = UnitX(Factor=subtraction_7)
vec_5 = VectorXYZ(XComponent=X_6, YComponent=Y_6, ZComponent=0)  # -> Vector, Length
box_5 = DomainBox(Base=vec_5.Vector, X="60", Y="10", Z="90")

multiplication_11 = Multiplication(A="10", B=item_7)
multiplication_12 = Multiplication(A="47.5", B=item_7)
subtraction_8 = Subtraction(A=multiplication_11, B="10")
addition_7 = Addition(A=subtraction_8, B=multiplication_12)
X_7 = UnitX(Factor=item_8)
Y_7 = UnitY(Factor=addition_7)
vec_6 = VectorXYZ(XComponent=X_7, YComponent=Y_7, ZComponent=0)  # -> Vector, Length
box_6 = DomainBox(Base=vec_6.Vector, X="60", Y="10", Z="90")

dom_13 = ConstructDomain(DomainStart="1", DomainEnd="8")
ma_7 = MassAddition(Input=panel_5)  # -> Result, PartialResults
random_13 = Random(Range=dom_13, Number="100", Seed=Slider(7781, range=0..10000))
round_7 = Round(Number=random_13)  # -> Nearest, Floor, Ceiling
item_13 = ListItem(List=round_7.Nearest, Index=ma_7.Result, Wrap=True)
dom_14 = ConstructDomain(DomainStart="0", DomainEnd="498")
random_14 = Random(Range=dom_14, Number="100", Seed=Slider(5156, range=0..10000))
item_14 = ListItem(List=random_14, Index=ma_7.Result, Wrap=True)

dom_15 = ConstructDomain(DomainStart="1", DomainEnd="8")
ma_8 = MassAddition(Input=panel_5)  # -> Result, PartialResults
random_15 = Random(Range=dom_15, Number="100", Seed=Slider(2921, range=0..10000))
round_8 = Round(Number=random_15)  # -> Nearest, Floor, Ceiling
item_15 = ListItem(List=round_8.Nearest, Index=ma_8.Result, Wrap=True)
dom_16 = ConstructDomain(DomainStart="0", DomainEnd="498")
random_16 = Random(Range=dom_16, Number="100", Seed=Slider(4235, range=0..10000))
item_16 = ListItem(List=random_16, Index=ma_8.Result, Wrap=True)

multiplication_13 = Multiplication(A="10", B=item_13)
multiplication_14 = Multiplication(A="47.5", B=item_13)
subtraction_9 = Subtraction(A=multiplication_13, B="10")
addition_8 = Addition(A=subtraction_9, B=multiplication_14)
X_8 = UnitX(Factor=addition_8)
Y_8 = UnitY(Factor=item_14)
vec_7 = VectorXYZ(XComponent=X_8, YComponent=Y_8, ZComponent=0)  # -> Vector, Length
box_7 = DomainBox(Base=vec_7.Vector, X="10", Y="10", Z="90")

multiplication_15 = Multiplication(A="10", B=item_15)
multiplication_16 = Multiplication(A="47.5", B=item_15)
subtraction_10 = Subtraction(A=multiplication_15, B="10")
addition_9 = Addition(A=subtraction_10, B=multiplication_16)
X_9 = UnitX(Factor=item_16)
Y_9 = UnitY(Factor=addition_9)
vec_8 = VectorXYZ(XComponent=X_9, YComponent=Y_9, ZComponent=0)  # -> Vector, Length
box_8 = DomainBox(Base=vec_8.Vector, X="10", Y="10", Z="90")

dom_17 = ConstructDomain(DomainStart="1", DomainEnd="8")
ma_9 = MassAddition(Input=panel_5)  # -> Result, PartialResults
random_17 = Random(Range=dom_17, Number="100", Seed=Slider(9496, range=0..10000))
round_9 = Round(Number=random_17)  # -> Nearest, Floor, Ceiling
item_17 = ListItem(List=round_9.Nearest, Index=ma_9.Result, Wrap=True)
dom_18 = ConstructDomain(DomainStart="0", DomainEnd="498")
random_18 = Random(Range=dom_18, Number="100", Seed=Slider(6962, range=0..10000))
item_18 = ListItem(List=random_18, Index=ma_9.Result, Wrap=True)

dom_19 = ConstructDomain(DomainStart="1", DomainEnd="8")
ma_10 = MassAddition(Input=panel_5)  # -> Result, PartialResults
random_19 = Random(Range=dom_19, Number="100", Seed=Slider(213, range=0..10000))
round_10 = Round(Number=random_19)  # -> Nearest, Floor, Ceiling
item_19 = ListItem(List=round_10.Nearest, Index=ma_10.Result, Wrap=True)
dom_20 = ConstructDomain(DomainStart="0", DomainEnd="498")
random_20 = Random(Range=dom_20, Number="100", Seed=Slider(2249, range=0..10000))
item_20 = ListItem(List=random_20, Index=ma_10.Result, Wrap=True)

multiplication_17 = Multiplication(A="10", B=item_17)
multiplication_18 = Multiplication(A="47.5", B=item_17)
subtraction_11 = Subtraction(A=multiplication_17, B="10")
addition_10 = Addition(A=subtraction_11, B=multiplication_18)
X_10 = UnitX(Factor=addition_10)
Y_10 = UnitY(Factor=item_18)
vec_9 = VectorXYZ(XComponent=X_10, YComponent=Y_10, ZComponent=0)  # -> Vector, Length
box_9 = DomainBox(Base=vec_9.Vector, X="10", Y="10", Z="90")

multiplication_19 = Multiplication(A="10", B=item_19)
multiplication_20 = Multiplication(A="47.5", B=item_19)
subtraction_12 = Subtraction(A=multiplication_19, B="10")
addition_11 = Addition(A=subtraction_12, B=multiplication_20)
X_11 = UnitX(Factor=item_20)
Y_11 = UnitY(Factor=addition_11)
vec_10 = VectorXYZ(XComponent=X_11, YComponent=Y_11, ZComponent=0)  # -> Vector, Length
box_10 = DomainBox(Base=vec_10.Vector, X="10", Y="10", Z="90")

dom_21 = ConstructDomain(DomainStart="1", DomainEnd="8")
ma_11 = MassAddition(Input=panel_5)  # -> Result, PartialResults
random_21 = Random(Range=dom_21, Number="100", Seed=Slider(2679, range=0..10000))
round_11 = Round(Number=random_21)  # -> Nearest, Floor, Ceiling
item_21 = ListItem(List=round_11.Nearest, Index=ma_11.Result, Wrap=True)
dom_22 = ConstructDomain(DomainStart="0", DomainEnd="448")
random_22 = Random(Range=dom_22, Number="100", Seed=Slider(1873, range=0..10000))
item_22 = ListItem(List=random_22, Index=ma_11.Result, Wrap=True)

dom_23 = ConstructDomain(DomainStart="1", DomainEnd="8")
ma_12 = MassAddition(Input=panel_5)  # -> Result, PartialResults
random_23 = Random(Range=dom_23, Number="100", Seed=Slider(5966, range=0..10000))
round_12 = Round(Number=random_23)  # -> Nearest, Floor, Ceiling
item_23 = ListItem(List=round_12.Nearest, Index=ma_12.Result, Wrap=True)
dom_24 = ConstructDomain(DomainStart="0", DomainEnd="498")
random_24 = Random(Range=dom_24, Number="100", Seed=Slider(6003, range=0..10000))
item_24 = ListItem(List=random_24, Index=ma_12.Result, Wrap=True)

dom_25 = ConstructDomain(DomainStart="1", DomainEnd="8")
ma_13 = MassAddition(Input=panel_5)  # -> Result, PartialResults
random_25 = Random(Range=dom_25, Number="100", Seed=Slider(3738, range=0..10000))
round_13 = Round(Number=random_25)  # -> Nearest, Floor, Ceiling
item_25 = ListItem(List=round_13.Nearest, Index=ma_13.Result, Wrap=True)
dom_26 = ConstructDomain(DomainStart="0", DomainEnd="498")
random_26 = Random(Range=dom_26, Number="100", Seed=Slider(4674, range=0..10000))
item_26 = ListItem(List=random_26, Index=ma_13.Result, Wrap=True)

multiplication_21 = Multiplication(A="10", B=item_23)
multiplication_22 = Multiplication(A="47.5", B=item_23)
subtraction_13 = Subtraction(A=multiplication_21, B="10")
addition_12 = Addition(A=subtraction_13, B=multiplication_22)
X_12 = UnitX(Factor=addition_12)
Y_12 = UnitY(Factor=item_24)
vec_11 = VectorXYZ(XComponent=X_12, YComponent=Y_12, ZComponent=0)  # -> Vector, Length
box_11 = DomainBox(Base=vec_11.Vector, X="10", Y="10", Z="180")

dom_27 = ConstructDomain(DomainStart="1", DomainEnd="8")
ma_14 = MassAddition(Input=panel_5)  # -> Result, PartialResults
random_27 = Random(Range=dom_27, Number="100", Seed=Slider(3769, range=0..10000))
round_14 = Round(Number=random_27)  # -> Nearest, Floor, Ceiling
item_27 = ListItem(List=round_14.Nearest, Index=ma_14.Result, Wrap=True)
dom_28 = ConstructDomain(DomainStart="0", DomainEnd="448")
random_28 = Random(Range=dom_28, Number="100", Seed=Slider(3963, range=0..10000))
item_28 = ListItem(List=random_28, Index=ma_14.Result, Wrap=True)

multiplication_23 = Multiplication(A="10", B=item_25)
multiplication_24 = Multiplication(A="47.5", B=item_25)
subtraction_14 = Subtraction(A=multiplication_23, B="10")
addition_13 = Addition(A=subtraction_14, B=multiplication_24)
X_13 = UnitX(Factor=item_26)
Y_13 = UnitY(Factor=addition_13)
vec_12 = VectorXYZ(XComponent=X_13, YComponent=Y_13, ZComponent=0)  # -> Vector, Length
box_12 = DomainBox(Base=vec_12.Vector, X="10", Y="10", Z="180")

colour_2 = ColourPicker(PickedColour=RGB(6, 60, 209))
panel_6 = Panel("prvnipodlazi")
preview_2 = CustomPreview(Geometry=[box, box_9, box_7, box_3, box_10, box_8, box_6, box_4, box_2, box_5], Material=colour_2)
Z = UnitZ(Factor="90")
Z_2 = UnitZ(Factor="90")

multiplication_25 = Multiplication(A="10", B=item_27)
multiplication_26 = Multiplication(A="47.5", B=item_27)
subtraction_15 = Subtraction(A=multiplication_25, B="10")
addition_14 = Addition(A=subtraction_15, B=multiplication_26)
subtraction_16 = Subtraction(A=addition_14, B="25")
X_14 = UnitX(Factor=item_28)
Y_14 = UnitY(Factor=subtraction_16)
vec_13 = VectorXYZ(XComponent=X_14, YComponent=Y_14, ZComponent=Z_2)  # -> Vector, Length
box_13 = DomainBox(Base=vec_13.Vector, X="10", Y="60", Z="90")

multiplication_27 = Multiplication(A="10", B=item_21)
multiplication_28 = Multiplication(A="47.5", B=item_21)
subtraction_17 = Subtraction(A=multiplication_27, B="10")
addition_15 = Addition(A=subtraction_17, B=multiplication_28)
X_15 = UnitX(Factor=item_22)
Y_15 = UnitY(Factor=addition_15)
vec_14 = VectorXYZ(XComponent=X_15, YComponent=Y_15, ZComponent=Z)  # -> Vector, Length
box_14 = DomainBox(Base=vec_14.Vector, X="60", Y="10", Z="90")

dom_29 = ConstructDomain(DomainStart="1", DomainEnd="8")
ma_15 = MassAddition(Input=panel_5)  # -> Result, PartialResults
random_29 = Random(Range=dom_29, Number="100", Seed=Slider(6774, range=0..10000))
round_15 = Round(Number=random_29)  # -> Nearest, Floor, Ceiling
item_29 = ListItem(List=round_15.Nearest, Index=ma_15.Result, Wrap=True)
dom_30 = ConstructDomain(DomainStart="0", DomainEnd="498")
random_30 = Random(Range=dom_30, Number="100", Seed=Slider(4890, range=0..10000))
item_30 = ListItem(List=random_30, Index=ma_15.Result, Wrap=True)

dom_31 = ConstructDomain(DomainStart="1", DomainEnd="8")
ma_16 = MassAddition(Input=panel_5)  # -> Result, PartialResults
random_31 = Random(Range=dom_31, Number="100", Seed=Slider(3777, range=0..10000))
round_16 = Round(Number=random_31)  # -> Nearest, Floor, Ceiling
item_31 = ListItem(List=round_16.Nearest, Index=ma_16.Result, Wrap=True)
dom_32 = ConstructDomain(DomainStart="0", DomainEnd="498")
random_32 = Random(Range=dom_32, Number="100", Seed=Slider(6094, range=0..10000))
item_32 = ListItem(List=random_32, Index=ma_16.Result, Wrap=True)

multiplication_29 = Multiplication(A="10", B=item_29)
multiplication_30 = Multiplication(A="47.5", B=item_29)
subtraction_18 = Subtraction(A=multiplication_29, B="10")
addition_16 = Addition(A=subtraction_18, B=multiplication_30)
X_16 = UnitX(Factor=addition_16)
Y_16 = UnitY(Factor=item_30)
vec_15 = VectorXYZ(XComponent=X_16, YComponent=Y_16, ZComponent=0)  # -> Vector, Length
box_15 = DomainBox(Base=vec_15.Vector, X="10", Y="10", Z="180")

multiplication_31 = Multiplication(A="10", B=item_31)
multiplication_32 = Multiplication(A="47.5", B=item_31)
subtraction_19 = Subtraction(A=multiplication_31, B="10")
addition_17 = Addition(A=subtraction_19, B=multiplication_32)
X_17 = UnitX(Factor=item_32)
Y_17 = UnitY(Factor=addition_17)
vec_16 = VectorXYZ(XComponent=X_17, YComponent=Y_17, ZComponent=0)  # -> Vector, Length
box_16 = DomainBox(Base=vec_16.Vector, X="10", Y="10", Z="180")

colour_3 = ColourPicker(PickedColour=RGB(232, 220, 0))
panel_7 = Panel("druhepodlazi")
preview_3 = CustomPreview(Geometry=[box_11, box_15, box_12, box_16, box_14, box_13], Material=colour_3)
